# Grasshopper definition 1kmx1kmtestkk_autosave.gh (Grasshopper 1.0.7)
# plug-ins: Bifocals, Human, LunchBox

number_slider = Slider(1, range=0..1)
# 修改这里的rgb值和高度区间
data = Data(["r,g,b,low,high", "103,0,13,0.8,3.6", "136,7,17,3.6,7.5", "167,15,21,7.5,11.3", "184,19,24,11.3,14", "200,23,28,14,17.3", "215,35,34,17.3,22.9", "230,49,40,22.9,28.1", "241,65,48,28.1,34", "246,85,60,34,42.7", "251,104,71,42.7,55", "252,120,88,55,64.5", "252,136,104,64.5,77.5", "252,153,122,77.5,92.8", "252,170,141,92.8,110.3", "252,186,160,110.3,127.5", "253,200,180,127.5,154.7", "254,216,200,154.7,179.3", "255,228,216,179.3,220.6", "255,237,228,220.6,282.3", "255,245,240,282.3,530.4"])
file_path = FilePath("C:\Users\Administrator\Desktop\height.csv")
read_file = ReadFile(File=file_path, PerLineParse=True)
read_file_2 = ReadFile(PerLineParse=True)
csv = ReadCSV(CSVString=read_file, Delimiter=",")  # -> Headers, Values
panel = Panel(csv.Headers)
bang = ExplodeTree(Data=csv.Values)  # -> Branch0, Branch1, Branch2, Branch3, Branch4
pt = ConstructPoint(XCoordinate=bang.Branch0, YCoordinate=bang.Branch1, ZCoordinate=bang.Branch2)  # -> simplify(graft(Point))
number_slider_2 = Slider(2, range=1..3)
pt_2 = ConstructPoint(XCoordinate=0, YCoordinate=0, ZCoordinate=0)
sph = Sphere(Base=pt, Radius=Slider(40, range=20..45))
item = ListItem(List=bang.Branch3, Index=0, Wrap=True)  # -> Item, Item1, Item2, Item3, Item4, Item5, Item6, Item7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
dom = ConstructDomain(DomainStart=item.Item5, DomainEnd=item.Item9)
dom_2 = ConstructDomain(DomainStart=Slider(3, range=0..10), DomainEnd=item.Item4)
dom_3 = ConstructDomain(DomainStart=item.Item10, DomainEnd=item.Item14)
dom_4 = ConstructDomain(DomainStart=item.Item15, DomainEnd=Slider(200, range=0..1000))
unit_z = UnitZ(Factor=1)

number_slider_3 = Slider(2, range=0..100)
number_slider_4 = Slider(600, range=0..600)
rectangular = Rectangular(
    Plane=PlaneXY(0, 0, 0),
    SizeX=number_slider_3,
    SizeY=number_slider_3,
    ExtentX=number_slider_4,
    ExtentY=Slider(300, range=0..600))  # -> Cells, flatten(Points)
image_sampler = ImageSampler(
    rectangular.Points,
    FilePath="C:\Users\Administrator\Desktop\10.1投稿用\1-10\1_gai.png",
    Filter="Colour",
    Interpolate=False,
    Umax=600,
    Umin=0,
    Vmax=600,
    Vmin=0,
    Wrap=1)
split_ahsv = SplitAHSV(Colour=image_sampler)  # -> Alpha, Hue, Saturation, flatten(Value)
split_argb = SplitARGB(Colour=image_sampler)  # -> Alpha, Red, Green, Blue
point = Point(rectangular.Points)
rectangle = Rectangle(Plane=rectangular.Points, XSize=number_slider_3, YSize=number_slider_3, Radius=0)  # -> Rectangle, Length
integer = Integer(split_argb.Alpha)

split_argb_2 = SplitARGB(Colour=image_sampler, IntegerChannels=True)  # -> Alpha, Red, Green, Blue
addition = Addition(A=number_slider_4, B=1)
pt_3 = ConstructPoint(XCoordinate=split_argb_2.Red, YCoordinate=split_argb_2.Green, ZCoordinate=split_argb_2.Blue)
multiplication = Multiplication(A=number_slider_3, B=addition)
multiplication_2 = Multiplication(A=number_slider_3, B=number_slider_4)
division = Division(A=number_slider_3, B=2)
rectangle_2 = Rectangle(Plane=pt_2, XSize=multiplication_2, YSize=multiplication_2, Radius=0)  # -> Rectangle, Length
brepinc = PointInBrep(Brep=sph, Point=pt_3, Strict=False)
split_ahsl = SplitAHSL(Colour=image_sampler)  # -> Alpha, Hue, Saturation, flatten(Luminance)
dispatch = Dispatch(List=point, DispatchPattern=brepinc)  # -> ListA, ListB
offset = OffsetCurve(Curve=rectangle_2.Rectangle, Distance=division, Corners=1)
bounds = Bounds(Numbers=split_argb.Red)

division_2 = Division(A=Slider(0, range=0..49), B=Slider(100, range=0..100))
division_3 = Division(A=Slider(100, range=0..100), B=Slider(100, range=0..100))
construct_domain = ConstructDomain(DomainStart=division_2, DomainEnd=division_3)
remap_numbers = RemapNumbers(Value=split_argb.Red, Source=bounds, Target=construct_domain)  # -> Mapped, Clipped

bounds_2 = Bounds(Numbers=split_argb.Green)

division_4 = Division(A=Slider(0, range=0..49), B=Slider(100, range=0..100))
division_5 = Division(A=Slider(100, range=0..100), B=Slider(100, range=0..100))
construct_domain_2 = ConstructDomain(DomainStart=division_4, DomainEnd=division_5)
remap_numbers_2 = RemapNumbers(Value=split_argb.Green, Source=bounds_2, Target=construct_domain_2)  # -> Mapped, Clipped

bounds_3 = Bounds(Numbers=split_argb.Blue)

division_6 = Division(A=Slider(0, range=0..49), B=Slider(100, range=0..100))
division_7 = Division(A=Slider(100, range=0..100), B=Slider(100, range=0..100))
construct_domain_3 = ConstructDomain(DomainStart=division_6, DomainEnd=division_7)
remap_numbers_3 = RemapNumbers(Value=split_argb.Blue, Source=bounds_3, Target=construct_domain_3)  # -> Mapped, Clipped

pt_4 = Point(dispatch.ListA)
rectangle_3 = Rectangle(Plane=pt_4, XSize="-1 to 1", YSize="-1 to 1", Radius=0)  # -> Rectangle, Length
data_2 = Data(image_sampler)
panel_2 = Panel(data_2)
multiplication_3 = Multiplication(A=remap_numbers.Mapped, B=number_slider_2)
multiplication_4 = Multiplication(A=remap_numbers_3.Mapped, B=number_slider_2)
multiplication_5 = Multiplication(A=remap_numbers_2.Mapped, B=number_slider_2)
bang_2 = ExplodeTree(Data=pt_4)  # -> Branch0, Branch1, Branch2, Branch3, Branch4, Branch5, Branch6, Branch7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
rectangle_4 = Rectangle(Plane=PlaneXY(0, 0, 0), XSize=multiplication, YSize=multiplication, Radius=0)  # -> Rectangle, Length
_1 = Point([bang_2.Branch10, bang_2.Branch11, bang_2.Branch12, bang_2.Branch13])
_1_2 = Point([bang_2.Branch0, bang_2.Branch1, bang_2.Branch2, bang_2.Branch3])
_1_3 = Point([bang_2.Branch5, bang_2.Branch6, bang_2.Branch7, bang_2.Branch8])
_1_4 = Point([bang_2.Branch15, bang_2.Branch16, bang_2.Branch17, bang_2.Branch18, bang_2.Branch19])
split_argb_3 = SplitARGB(Colour=image_sampler, IntegerChannels=True)  # -> Alpha, Red, Green, Blue
bang_3 = ExplodeTree(Data=rectangle_3.Rectangle)  # -> Branch0, Branch1, Branch2, Branch3, Branch4, Branch5, Branch6, Branch7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
construct_point = ConstructPoint(XCoordinate=split_argb_3.Red, YCoordinate=split_argb_3.Green, ZCoordinate=split_argb_3.Blue)
region_union = RegionUnion(Curves=flatten([bang_3.Branch10, bang_3.Branch11, bang_3.Branch12, bang_3.Branch13]))  # -> flatten(Result)
region_union_2 = RegionUnion(Curves=flatten([bang_3.Branch0, bang_3.Branch1, bang_3.Branch2, bang_3.Branch3]))  # -> flatten(Result)
region_union_3 = RegionUnion(Curves=flatten([bang_3.Branch5, bang_3.Branch6, bang_3.Branch7, bang_3.Branch8]))  # -> flatten(Result)
region_union_4 = RegionUnion(Curves=flatten([bang_3.Branch17, bang_3.Branch18, bang_3.Branch19, bang_3.Branch16, bang_3.Branch15]))  # -> flatten(Result)
rectangle_5 = Rectangle(Plane=point, XSize="-1 to 1", YSize="-1 to 1", Radius=0)  # -> Rectangle, Length
cluster = Cluster(geometry=region_union_2, list=region_union_2, second_number=Slider(90, range=0..40000))
cluster_2 = Cluster(geometry=region_union, list=region_union, second_number=Slider(90, range=0..40000))
cluster_3 = Cluster(geometry=region_union_3, list=region_union_3, second_number=Slider(90, range=0..40000))
cluster_4 = Cluster(geometry=region_union_4, list=region_union_4, second_number=Slider(90, range=0..40000))
data_3 = Data(cluster)
data_4 = Data(cluster_2)
data_5 = Data(cluster_3)
data_6 = Data(cluster_4)
data_7 = Data(data_3)
data_8 = Data(data_4)
data_9 = Data(data_5)
cluster_5 = Cluster_2(curve=data_7, domain_start=Slider(50, range=0..50), domain_end=Slider(90, range=0..100))
data_10 = Data(data_6)
cluster_6 = Cluster_2(curve=data_8, domain_start=Slider(25, range=0..50), domain_end=Slider(85, range=0..100))
cluster_7 = Cluster_2(curve=data_9, domain_start=Slider(31, range=0..50), domain_end=Slider(81, range=0..100))
cluster_8 = Cluster_2(curve=data_10, domain_start=Slider(18, range=0..50), domain_end=Slider(30, range=0..100))
simplify_curve = SimplifyCurve(Curve=cluster_6, Tolerance=Slider(25, range=0..100), AngleTolerance=Slider(1, range=0..1))  # -> Curve, Simplified
simplify_curve_2 = SimplifyCurve(Curve=cluster_5, Tolerance=Slider(40, range=0..100), AngleTolerance=Slider(0.9, range=0..1))  # -> Curve, Simplified
simplify_curve_3 = SimplifyCurve(Curve=cluster_7, Tolerance=Slider(47, range=0..100), AngleTolerance=Slider(0.9, range=0..1))  # -> Curve, Simplified
simplify_curve_4 = SimplifyCurve(Curve=cluster_8, Tolerance=Slider(15, range=0..100), AngleTolerance=Slider(0.9, range=0..1))  # -> Curve, Simplified
crv = Curve(simplify_curve_2.Curve)
area = Area(Geometry=crv)  # -> Area, Centroid
null = NullItem(Item=area.Centroid)  # -> NullFlags, InvalidFlags, Description
crv_2 = Curve(simplify_curve_3.Curve)
crv_3 = Curve(simplify_curve.Curve)
crv_4 = Curve(simplify_curve_4.Curve)
dispatch_2 = Dispatch(List=area.Centroid, DispatchPattern=null.NullFlags)  # -> ListA, flatten(ListB)
dispatch_3 = Dispatch(List=crv, DispatchPattern=null.NullFlags)  # -> ListA, flatten(ListB)
area_2 = Area(Geometry=crv_2)  # -> Area, Centroid
area_3 = Area(Geometry=crv_3)  # -> Area, Centroid
area_4 = Area(Geometry=crv_4)  # -> Area, Centroid
lng = ListLength(List=crv_3)
lng_2 = ListLength(List=crv_4)
lng_3 = ListLength(List=dispatch_3.ListB)
cps = ClosestPoints(Point=dispatch_2.ListB, Cloud=point, Count=1)  # -> flatten(ClosestPoint), flatten(CPIndex), Distance
random = Random(Range=dom_3, Number=lng, Seed=2)
cps_2 = ClosestPoints(Point=area_2.Centroid, Cloud=point, Count=1)  # -> flatten(ClosestPoint), flatten(CPIndex), Distance
random_2 = Random(Range=dom_4, Number=lng_2, Seed=2)
data_11 = Data(image_sampler)
cps_3 = ClosestPoints(Point=area_3.Centroid, Cloud=point, Count=1)  # -> flatten(ClosestPoint), flatten(CPIndex), Distance
data_12 = Data(image_sampler)
cps_4 = ClosestPoints(Point=area_4.Centroid, Cloud=point, Count=1)  # -> flatten(ClosestPoint), flatten(CPIndex), Distance
data_13 = Data(image_sampler)
data_14 = Data(image_sampler)
random_3 = Random(Range=dom_2, Number=lng_3, Seed=2)
item_2 = ListItem(List=data_11, Index=cps.CPIndex, Wrap=True)
item_3 = ListItem(List=split_ahsl.Luminance, Index=cps.CPIndex, Wrap=True)
item_4 = ListItem(List=data_12, Index=cps_2.CPIndex, Wrap=True)
item_5 = ListItem(List=split_ahsl.Luminance, Index=cps_2.CPIndex, Wrap=True)
item_6 = ListItem(List=data_13, Index=cps_3.CPIndex, Wrap=True)
item_7 = ListItem(List=split_ahsl.Luminance, Index=cps_3.CPIndex, Wrap=True)
item_8 = ListItem(List=data_14, Index=cps_4.CPIndex, Wrap=True)
item_9 = ListItem(List=split_ahsl.Luminance, Index=cps_4.CPIndex, Wrap=True)
sort = SortList(Keys=random_3, ValuesA=random_3)  # -> Keys, ValuesA
sort_2 = SortList(Keys=item_3, ValuesA=dispatch_3.ListB)  # -> Keys, ValuesA
sort_3 = SortList(Keys=item_5, ValuesA=crv_2)  # -> Keys, ValuesA
sort_4 = SortList(Keys=random, ValuesA=random)  # -> Keys, ValuesA
sort_5 = SortList(Keys=item_7, ValuesA=crv_3)  # -> Keys, ValuesA
sort_6 = SortList(Keys=random_2, ValuesA=random_2)  # -> Keys, ValuesA
sort_7 = SortList(Keys=item_9, ValuesA=crv_4)  # -> Keys, ValuesA
panel_3 = Panel(item_2)
panel_4 = Panel(item_4)
panel_5 = Panel(item_6)
boundary = BoundarySurfaces(Edges=sort_2.ValuesA)
Z = UnitZ(Factor=sort.ValuesA)
panel_6 = Panel(item_8)
srf = Surface(sort_3.ValuesA)
boundary_2 = BoundarySurfaces(Edges=sort_3.ValuesA)
lng_4 = ListLength(List=boundary_2)
random_4 = Random(Range=dom, Number=lng_4, Seed=2)
sort_8 = SortList(Keys=random_4, ValuesA=random_4)  # -> Keys, ValuesA
srf_2 = Surface(sort_2.ValuesA)
srf_3 = Surface(sort_5.ValuesA)
Z_2 = UnitZ(Factor=sort_4.ValuesA)
Z_3 = UnitZ(Factor=sort_6.ValuesA)
srf_4 = Surface(sort_7.ValuesA)
extr = Extrude(Base=boundary, Direction=Z)
Z_4 = UnitZ(Factor=sort_8.ValuesA)
extr_2 = Extrude(Base=srf_3, Direction=Z_2)
extr_3 = Extrude(Base=srf_4, Direction=Z_3)
preview = CustomPreview(Geometry=cps.ClosestPoint, Material=item_2)  # disabled
extr_4 = Extrude(Base=boundary_2, Direction=Z_4)
merge = Merge(Data1=extr, Data2=extr_4, Data3=extr_2, Data4=extr_3)
brep = Brep(flatten(merge))
srf_5 = Surface(offset)  # disabled
contour = Contour(Shape=brep, Point=Point(0, 0, 0), Direction=unit_z, Distance=Slider(3.2, range=0..10))
custom_preview = CustomPreview(Geometry=brep, Material=ColourSwatch(SwatchColor=RGB(197, 178, 170)))  # disabled
custom_preview_lineweights = CustomPreviewLineweights(Geometry=contour, Shader=ColourSwatch(SwatchColor=RGB(255, 255, 255)), Thickness=Slider(1, range=0..10), Absolute=False)

integer_2 = Integer(multiplication_3)
integer_3 = Integer(multiplication_5)
integer_4 = Integer(multiplication_4)

division_8 = Division(A=integer_3, B=number_slider_2)
division_9 = Division(A=integer_4, B=number_slider_2)
division_10 = Division(A=integer_2, B=number_slider_2)

colour_rgb_f = ColourRGBF(Alpha=integer, Red=division_10, Green=division_8, Blue=division_9)

custom_preview_lineweights_2 = CustomPreviewLineweights(Geometry=construct_point, Shader=colour_rgb_f, Absolute=False)
custom_preview_lineweights_3 = CustomPreviewLineweights(Geometry=rectangle_5.Rectangle, Shader=colour_rgb_f, Absolute=False)

# ==== cluster Cluster
geometry = ClusterInput()
area = Area(Geometry=geometry)  # -> Area, Centroid
second_number = ClusterInput()
larger_than = LargerThan(FirstNumber=area.Area, SecondNumber=second_number)  # -> LargerThan, OrEqualTo
list = ClusterInput()
dispatch = Dispatch(List=list, DispatchPattern=larger_than.LargerThan)  # -> ListA, ListB
list_a = ClusterOutput(dispatch.ListA)

# ==== cluster Cluster_2
curve = ClusterInput()
curve_2 = Curve(curve)
domain_start = ClusterInput()
domain_end = ClusterInput()
construct_domain = ConstructDomain(DomainStart=domain_start, DomainEnd=domain_end)
length = Length(Curve=curve_2)
bounds = Bounds(Numbers=length)
remap_numbers = RemapNumbers(Value=length, Source=bounds, Target=construct_domain)  # -> Mapped, Clipped
divide_curve = DivideCurve(Curve=curve_2, Count=remap_numbers.Mapped, Kinks=False)  # -> Points, Tangents, Parameters
polyline = PolyLine(Vertices=divide_curve.Points, Closed=True)  # -> flatten(Polyline)
polyline_2 = ClusterOutput(polyline)
