# Grasshopper definition uwg.gh (Grasshopper 1.0.7)

# ----
# Office Buildings
officesolids = Geometry([<brep referenced from the Rhino model> x715])
panel = Panel("""1@5
2@4
@3""")
buildingsolid = DFBuildingFromSolid(
    bldg_geo=flatten(officesolids),
    floor_to_floor=panel,
    name="OfficeBldg",
    program="2013::LargeOffice::OpenOffice",
    run=Toggle(True))  # -> report, buildings; plug-in component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
simpleratiopar = DFSimpleWindowRatioParameters(ratio="0.6")  # -> win_par; plug-in component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
applyfacadepar = DFApplyFacadeParameters(df_obj=flatten(buildingsolid.buildings), win_par=simpleratiopar)  # -> report, df_obj; plug-in component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

# ----
# Parking Buildings
transportationsolids = Geometry()
buildingsolid_2 = DFBuildingFromSolid(
    bldg_geo=flatten(transportationsolids),
    floor_to_floor="@4",
    name="ParkingBldg",
    program="2013::Warehouse::Bulk",
    run=Toggle(True))  # -> report, buildings; plug-in component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
simpleratiopar_2 = DFSimpleWindowRatioParameters(ratio="0.15")  # -> win_par; plug-in component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
applyfacadepar_2 = DFApplyFacadeParameters(df_obj=flatten(buildingsolid_2.buildings), win_par=simpleratiopar_2)  # -> report, df_obj; plug-in component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

# ----
# Residential Buildings
panel_2 = Panel("2013::MidriseApartment::Apartment")
residentialsolids = Geometry([<brep referenced from the Rhino model> x62])
buildingsolid_3 = DFBuildingFromSolid(bldg_geo=flatten(residentialsolids), floor_to_floor="@4.2", name="ResidentialBldg", program=panel_2, run=Toggle(True))  # -> report, buildings; plug-in component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
simpleratiopar_3 = DFSimpleWindowRatioParameters(ratio="0.3")  # -> win_par; plug-in component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
applyfacadepar_3 = DFApplyFacadeParameters(df_obj=flatten(buildingsolid_3.buildings), win_par=simpleratiopar_3)  # -> report, df_obj; plug-in component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

transportationsolids_2 = Geometry()

# ----
# Office Buildings
officesolids_2 = Geometry([<brep referenced from the Rhino model> x751])
panel_3 = Panel("""1@5
2@4
@3""")
buildingsolid_4 = DFBuildingFromSolid(
    bldg_geo=flatten(officesolids_2),
    floor_to_floor=panel_3,
    name="OfficeBldg",
    program="2013::LargeOffice::OpenOffice",
    run=Toggle(True))  # -> report, buildings; plug-in component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
simpleratiopar_4 = DFSimpleWindowRatioParameters(ratio="0.6")  # -> win_par; plug-in component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
applyfacadepar_4 = DFApplyFacadeParameters(df_obj=flatten(buildingsolid_4.buildings), win_par=simpleratiopar_4)  # -> report, df_obj; plug-in component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

residentialsolids_2 = Geometry([<brep referenced from the Rhino model> x62])

# ----
# Office Buildings
officesolids_3 = Geometry([<brep referenced from the Rhino model> x715])
panel_4 = Panel("""1@5
2@4
@3""")
buildingsolid_5 = DFBuildingFromSolid(
    bldg_geo=flatten(officesolids_3),
    floor_to_floor=panel_4,
    name="OfficeBldg",
    program="2013::LargeOffice::OpenOffice",
    run=Toggle(True))  # -> report, buildings; plug-in component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
simpleratiopar_5 = DFSimpleWindowRatioParameters(ratio="0.6")  # -> win_par; plug-in component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
applyfacadepar_5 = DFApplyFacadeParameters(df_obj=flatten(buildingsolid_5.buildings), win_par=simpleratiopar_5)  # -> report, df_obj; plug-in component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

transportationsolids_3 = Geometry()
transportationsolids_4 = Geometry()
residentialsolids_3 = Geometry([<brep referenced from the Rhino model> x62])
buildingsolid_6 = DFBuildingFromSolid(
    bldg_geo=flatten(transportationsolids_2),
    floor_to_floor="@4",
    name="ParkingBldg",
    program="2013::Warehouse::Bulk",
    run=Toggle(True))  # -> report, buildings; plug-in component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
residentialsolids_4 = Geometry([<brep referenced from the Rhino model> x62])
buildingsolid_7 = DFBuildingFromSolid(
    bldg_geo=flatten(residentialsolids_2),
    floor_to_floor="@4.2",
    name="ResidentialBldg",
    program="2013::MidriseApartment::Apartment",
    run=Toggle(True))  # -> report, buildings; plug-in component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
buildingsolid_8 = DFBuildingFromSolid(
    bldg_geo=flatten(transportationsolids_3),
    floor_to_floor="@4",
    name="ParkingBldg",
    program="2013::Warehouse::Bulk",
    run=Toggle(True))  # -> report, buildings; plug-in component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
buildingsolid_9 = DFBuildingFromSolid(
    bldg_geo=flatten(transportationsolids_4),
    floor_to_floor="@4",
    name="ParkingBldg",
    program="2013::Warehouse::Bulk",
    run=Toggle(True))  # -> report, buildings; plug-in component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
buildingsolid_10 = DFBuildingFromSolid(
    bldg_geo=flatten(residentialsolids_3),
    floor_to_floor="@4.2",
    name="ResidentialBldg",
    program="2013::MidriseApartment::Apartment",
    run=Toggle(True))  # -> report, buildings; plug-in component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
buildingsolid_11 = DFBuildingFromSolid(
    bldg_geo=flatten(residentialsolids_4),
    floor_to_floor="@4.2",
    name="ResidentialBldg",
    program="2013::MidriseApartment::Apartment",
    run=Toggle(True))  # -> report, buildings; plug-in component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
simpleratiopar_6 = DFSimpleWindowRatioParameters()  # -> win_par; plug-in component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
# Residential Buildings
simpleratiopar_7 = DFSimpleWindowRatioParameters(ratio="0.3")  # -> win_par; plug-in component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
simpleratiopar_8 = DFSimpleWindowRatioParameters()  # -> win_par; plug-in component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
simpleratiopar_9 = DFSimpleWindowRatioParameters()  # -> win_par; plug-in component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
applyfacadepar_6 = DFApplyFacadeParameters(df_obj=flatten(buildingsolid_7.buildings), win_par=simpleratiopar_7)  # -> report, df_obj; plug-in component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
simpleratiopar_10 = DFSimpleWindowRatioParameters(ratio="0.3")  # -> win_par; plug-in component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
simpleratiopar_11 = DFSimpleWindowRatioParameters(ratio="0.3")  # -> win_par; plug-in component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
applyfacadepar_7 = DFApplyFacadeParameters(df_obj=flatten(buildingsolid_10.buildings), win_par=simpleratiopar_10)  # -> report, df_obj; plug-in component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
applyfacadepar_8 = DFApplyFacadeParameters(df_obj=flatten(buildingsolid_6.buildings), win_par=simpleratiopar_6)  # -> report, df_obj; plug-in component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

# ----
# Edit Building UWG Properties
bldgvintages = HBBuildingVintages({"ASHRAE 90.1 2013  |  IECC 2015": "2013", "ASHRAE 90.1 2010  |  IECC 2012": "2010", "ASHRAE 90.1 2007  |  IECC 2009": "2007", "ASHRAE 90.1 2004  |  IECC 2006": "2004", "1980-2004 (CBECS)": "1980_2004", "Pre-1980 (CBECS)": "pre_1980"}, selected="ASHRAE 90.1 2010  |  IECC 2012")
buildinguwg = DFAssignBuildingUWGProperties(building=applyfacadepar_3.df_obj, vintage=bldgvintages, fr_canyon="1")  # -> report, building; plug-in component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

applyfacadepar_9 = DFApplyFacadeParameters(df_obj=flatten(buildingsolid_11.buildings), win_par=simpleratiopar_11)  # -> report, df_obj; plug-in component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
bldgvintages_2 = HBBuildingVintages({"ASHRAE 90.1 2013  |  IECC 2015": "2013", "ASHRAE 90.1 2010  |  IECC 2012": "2010", "ASHRAE 90.1 2007  |  IECC 2009": "2007", "ASHRAE 90.1 2004  |  IECC 2006": "2004", "1980-2004 (CBECS)": "1980_2004", "Pre-1980 (CBECS)": "pre_1980"}, selected="ASHRAE 90.1 2010  |  IECC 2012")
applyfacadepar_10 = DFApplyFacadeParameters(df_obj=flatten(buildingsolid_8.buildings), win_par=simpleratiopar_8)  # -> report, df_obj; plug-in component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
applyfacadepar_11 = DFApplyFacadeParameters(df_obj=flatten(buildingsolid_9.buildings), win_par=simpleratiopar_9)  # -> report, df_obj; plug-in component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
buildinguwg_2 = DFAssignBuildingUWGProperties(vintage=bldgvintages_2, fr_canyon="1")  # -> report, building; plug-in component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

# ----
# Office Buildings
officesolids_4 = Geometry([<brep referenced from the Rhino model> x688])
panel_5 = Panel("""1@5
2@4
@3""")
buildingsolid_12 = DFBuildingFromSolid(
    bldg_geo=flatten(officesolids_4),
    floor_to_floor=panel_5,
    name="OfficeBldg",
    program="2013::LargeOffice::OpenOffice",
    run=Toggle(True))  # -> report, buildings; plug-in component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
simpleratiopar_12 = DFSimpleWindowRatioParameters(ratio="0.6")  # -> win_par; plug-in component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
applyfacadepar_12 = DFApplyFacadeParameters(df_obj=flatten([buildinguwg_2.building, buildingsolid_12.buildings]), win_par=simpleratiopar_12)  # -> report, df_obj; plug-in component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

# ----
# Weather File and Simulation Period
panel_6 = Panel("https://energyplus-weather.s3.amazonaws.com/north_and_central_america_wmo_region_4/USA/AZ/USA_AZ_Phoenix-Sky.Harbor.Intl.AP.722780_TMY3/USA_AZ_Phoenix-Sky.Harbor.Intl.AP.722780_TMY3.zip")
downloadepw = LBDownloadWeather(weather_URL=panel_6)  # -> epw_file, stat_file, ddy_file; plug-in component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
analysisperiod = LBAnalysisPeriod(start_month="3", start_day=1, start_hour=0, end_month="3")  # -> period, hoys, dates; plug-in component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

panel_7 = Panel("5")

# ----
# UWG Simulation
# Parameters
panel_8 = Panel("0.3")
boundarylayer = DFBoundaryLayerParameters()  # -> bnd_layer; plug-in component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
refepwpar = DFReferenceEPWParameters(veg_cover="0.2")  # -> epw_site; plug-in component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
vegetationpar = DFVegetationParameters(albedo=panel_8)  # -> veg_par; plug-in component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

# ---- group: 绿地
green = Surface([<surface referenced from the Rhino model> x501])

# ---- group: 地形
terrain = Geometry(<surface referenced from the Rhino model>)

# ---- group: 绿地
green_2 = Surface([<surface referenced from the Rhino model> x473])

green_3 = Surface([<surface referenced from the Rhino model> x515])

green_4 = Surface([<surface referenced from the Rhino model> x473])

# ----
# UWG Simulation
# Parameters
panel_9 = Panel("0.3")
boundarylayer_2 = DFBoundaryLayerParameters()  # -> bnd_layer; plug-in component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
refepwpar_2 = DFReferenceEPWParameters(veg_cover="0.95")  # -> epw_site; plug-in component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
vegetationpar_2 = DFVegetationParameters(albedo=panel_9)  # -> veg_par; plug-in component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

# ----
# UWG Simulation
# Parameters
panel_10 = Panel("0.3")
boundarylayer_3 = DFBoundaryLayerParameters()  # -> bnd_layer; plug-in component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
refepwpar_3 = DFReferenceEPWParameters(veg_cover="0.95")  # -> epw_site; plug-in component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
vegetationpar_3 = DFVegetationParameters(albedo=panel_10)  # -> veg_par; plug-in component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

# ----
# UWG Simulation
# Parameters
panel_11 = Panel("0.3")
boundarylayer_4 = DFBoundaryLayerParameters()  # -> bnd_layer; plug-in component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
refepwpar_4 = DFReferenceEPWParameters(veg_cover="0.95")  # -> epw_site; plug-in component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
vegetationpar_4 = DFVegetationParameters(albedo=panel_11)  # -> veg_par; plug-in component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

custom_preview = CustomPreview(Material={diffuse=RGB(221, 160, 221), emission=RGB(66, 48, 66), shine=0.5, specular=RGB(255, 255, 255), transparency=0})
pt = Point()

panel_12 = Panel(buildingsolid.report)
all_buildings = Data(flatten([applyfacadepar.df_obj, applyfacadepar_2.df_obj]))
panel_13 = Panel("C:\测温\GZ_DATA\CHN_Guangdong.Guangzhou.592870_IWEC.epw")
uwgsimpar = DFUWGSimulationParameter(run_period=analysisperiod.period, veg_par=vegetationpar, epw_site=refepwpar, bnd_layer=boundarylayer)  # -> sim_par; plug-in component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
toggle = BooleanToggle(True)
legendpar = LBLegendParameters(min="15", max="20", seg_count="12", num_decimals="0")  # -> leg_par; plug-in component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

# ----
# Create Dragonfly Model
toggle_2 = BooleanToggle(True)
trees = Geometry([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])
context = DFContextShade(geo=trees, name="Trees", uwg_is_veg=toggle_2)  # -> report, context; plug-in component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
model = DFModel(buildings=flatten(all_buildings), context=flatten(context.context), name="Downtown District")  # -> report, model; plug-in component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

# ----
# Create Dragonfly Model
toggle_3 = BooleanToggle(True)
trees_2 = Geometry([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])
context_2 = DFContextShade(geo=trees_2, name="Trees", uwg_is_veg=toggle_3)  # -> report, context; plug-in component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

# ----
# Create Dragonfly Model
toggle_4 = BooleanToggle(True)
trees_3 = Geometry([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])
context_3 = DFContextShade(geo=trees_3, name="Trees", uwg_is_veg=toggle_4)  # -> report, context; plug-in component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

# ----
# Create Dragonfly Model
toggle_5 = BooleanToggle(True)
trees_4 = Geometry([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])
context_4 = DFContextShade(geo=trees_4, name="Trees", uwg_is_veg=toggle_5)  # -> report, context; plug-in component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

all_buildings_2 = Data(flatten([applyfacadepar_4.df_obj, applyfacadepar_9.df_obj, applyfacadepar_10.df_obj]))
uwgsimpar_2 = DFUWGSimulationParameter(run_period=analysisperiod.period, veg_par=vegetationpar_3, epw_site=refepwpar_3, bnd_layer=boundarylayer_3)  # -> sim_par; plug-in component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
toggle_6 = BooleanToggle(True)

model_2 = DFModel(buildings=flatten(all_buildings_2), context=flatten(context_3.context), name="Downtown District")  # -> report, model; plug-in component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

all_buildings_3 = Data(flatten([applyfacadepar_5.df_obj, applyfacadepar_11.df_obj, applyfacadepar_7.df_obj]))
uwgsimpar_3 = DFUWGSimulationParameter(run_period=analysisperiod.period, veg_par=vegetationpar_4, epw_site=refepwpar_4, bnd_layer=boundarylayer_4)  # -> sim_par; plug-in component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
toggle_7 = BooleanToggle(True)

model_3 = DFModel(buildings=flatten(all_buildings_3), context=flatten(context_4.context), name="Downtown District")  # -> report, model; plug-in component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

all_buildings_4 = Data(flatten([applyfacadepar_12.df_obj, applyfacadepar_8.df_obj, applyfacadepar_6.df_obj]))
uwgsimpar_4 = DFUWGSimulationParameter(run_period=analysisperiod.period, veg_par=vegetationpar_2, epw_site=refepwpar_2, bnd_layer=boundarylayer_2)  # -> sim_par; plug-in component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
toggle_8 = BooleanToggle(True)

model_4 = DFModel(buildings=flatten(all_buildings_4), context=flatten(context_2.context), name="Downtown District")  # -> report, model; plug-in component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

# ----
# Edit District UWG Properties
panel_14 = Panel("20")
traffic = DFTrafficParameters(watts_per_area=panel_14)  # -> traffic; plug-in component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
terrain_2 = DFTerrain(terrain_geo=terrain)  # -> terrain; plug-in component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

# ----
# Edit District UWG Properties
terrain_3 = Geometry(<surface referenced from the Rhino model>)
traffic_2 = DFTrafficParameters(watts_per_area="20")  # -> traffic; plug-in component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
terrain_4 = DFTerrain(terrain_geo=terrain_3)  # -> terrain; plug-in component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

area = Area(Geometry=green_3)  # -> Area, Centroid

ma = MassAddition(Input=area.Area)  # -> Result, PartialResults

area_2 = Area(Geometry=green_4)  # -> Area, Centroid

ma_2 = MassAddition(Input=area_2.Area)  # -> Result, PartialResults

area_3 = Area(Geometry=green)  # -> Area, Centroid
area_4 = Area(Geometry=terrain_3)  # -> Area, Centroid

ma_3 = MassAddition(Input=area_3.Area)  # -> Result, PartialResults

division = Division(A=ma_3.Result, B=area_4.Area)
multiplication = Multiplication(A=division, B="0.95")

modeluwg = DFAssignModelUWGProperties(model=model_4.model, terrain=terrain_4, traffic=traffic_2, tree_cover=multiplication, grass_cover=division)  # -> report, model; plug-in component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
panel_15 = Panel(modeluwg.report)

runuwg = DFRunUrbanWeatherGenerator(model=modeluwg.model, epw_file=panel_13, sim_par=uwgsimpar_4, write=toggle_8, run=toggle_8)  # -> report, uwg_json, urban_epw; plug-in component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
importepw = LBImportEPW(epw_file=runuwg.urban_epw)  # -> location, dry_bulb_temperature, dew_point_temperature, relative_humidity, wind_speed, wind_direction, direct_normal_rad, diffuse_horizontal_rad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; plug-in component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
applyper = LBApplyAnalysisPeriod(data=importepw.dry_bulb_temperature, period=analysisperiod.period)  # -> data; plug-in component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
timeop = LBTimeIntervalOperation(data=applyper)  # -> daily, monthly, mon_per_hr; plug-in component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

# ----
# Edit District UWG Properties
terrain_5 = Geometry(<surface referenced from the Rhino model>)
traffic_3 = DFTrafficParameters(watts_per_area="20")  # -> traffic; plug-in component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
terrain_6 = DFTerrain(terrain_geo=terrain_5)  # -> terrain; plug-in component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

area_5 = Area(Geometry=terrain_5)  # -> Area, Centroid
division_2 = Division(A=ma.Result, B=area_5.Area)
multiplication_2 = Multiplication(A=division_2, B="0.95")

modeluwg_2 = DFAssignModelUWGProperties(model=model_2.model, terrain=terrain_6, traffic=traffic_3, tree_cover=multiplication_2, grass_cover=division_2)  # -> report, model; plug-in component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
panel_16 = Panel(modeluwg_2.report)

runuwg_2 = DFRunUrbanWeatherGenerator(model=modeluwg_2.model, epw_file=panel_13, sim_par=uwgsimpar_2, write=toggle_6, run=toggle_6)  # -> report, uwg_json, urban_epw; plug-in component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
importepw_2 = LBImportEPW(epw_file=runuwg_2.urban_epw)  # -> location, dry_bulb_temperature, dew_point_temperature, relative_humidity, wind_speed, wind_direction, direct_normal_rad, diffuse_horizontal_rad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; plug-in component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
applyper_2 = LBApplyAnalysisPeriod(data=importepw_2.dry_bulb_temperature, period=analysisperiod.period)  # -> data; plug-in component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
timeop_2 = LBTimeIntervalOperation(data=applyper_2)  # -> daily, monthly, mon_per_hr; plug-in component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

# ----
# Edit District UWG Properties
terrain_7 = Geometry(<surface referenced from the Rhino model>)
traffic_4 = DFTrafficParameters(watts_per_area="20")  # -> traffic; plug-in component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
terrain_8 = DFTerrain(terrain_geo=terrain_7)  # -> terrain; plug-in component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

area_6 = Area(Geometry=terrain_7)  # -> Area, Centroid
division_3 = Division(A=ma_2.Result, B=area_6.Area)
multiplication_3 = Multiplication(A=division_3, B="0.95")

modeluwg_3 = DFAssignModelUWGProperties(model=model_3.model, terrain=terrain_8, traffic=traffic_4, tree_cover=multiplication_3, grass_cover=division_3)  # -> report, model; plug-in component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
panel_17 = Panel(modeluwg_3.report)

runuwg_3 = DFRunUrbanWeatherGenerator(model=modeluwg_3.model, epw_file=panel_13, sim_par=uwgsimpar_3, write=toggle_7, run=toggle_7)  # -> report, uwg_json, urban_epw; plug-in component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
importepw_3 = LBImportEPW(epw_file=runuwg_3.urban_epw)  # -> location, dry_bulb_temperature, dew_point_temperature, relative_humidity, wind_speed, wind_direction, direct_normal_rad, diffuse_horizontal_rad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; plug-in component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
applyper_3 = LBApplyAnalysisPeriod(data=importepw_3.dry_bulb_temperature, period=analysisperiod.period)  # -> data; plug-in component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
timeop_3 = LBTimeIntervalOperation(data=applyper_3)  # -> daily, monthly, mon_per_hr; plug-in component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

area_7 = Area(Geometry=green_2)  # -> Area, Centroid
area_8 = Area(Geometry=terrain)  # -> Area, Centroid

ma_4 = MassAddition(Input=area_7.Area)  # -> Result, PartialResults

division_4 = Division(A=ma_4.Result, B=area_8.Area)
multiplication_4 = Multiplication(A=division_4, B="0.95")

modeluwg_4 = DFAssignModelUWGProperties(model=model.model, terrain=terrain_2, traffic=traffic, tree_cover=multiplication_4, grass_cover=division_4)  # -> report, model; plug-in component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
panel_18 = Panel(modeluwg_4.report)

runuwg_4 = DFRunUrbanWeatherGenerator(model=modeluwg_4.model, epw_file=panel_13, sim_par=uwgsimpar, write=toggle, run=toggle)  # -> report, uwg_json, urban_epw; plug-in component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
importepw_4 = LBImportEPW(epw_file=runuwg_4.urban_epw)  # -> location, dry_bulb_temperature, dew_point_temperature, relative_humidity, wind_speed, wind_direction, direct_normal_rad, diffuse_horizontal_rad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; plug-in component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
applyper_4 = LBApplyAnalysisPeriod(data=importepw_4.dry_bulb_temperature, period=analysisperiod.period)  # -> data; plug-in component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
timeop_4 = LBTimeIntervalOperation(data=applyper_4)  # -> daily, monthly, mon_per_hr; plug-in component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

# ----
# Visualize EPW Output
monthlychart = LBMonthlyChart(
    data=[timeop_4.mon_per_hr, timeop.mon_per_hr, timeop_3.mon_per_hr, timeop_2.mon_per_hr],
    base_pt="5,5,5",
    x_dim="40",
    legend_par=legendpar)  # -> out, data_mesh, data_lines, col_lines, legend, borders, labels, y_title, title, vis_set; plug-in component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
